# Dynamo graph Interfaz grafica.dyn (Dynamo 2.13.1.3887)
# packages: Data-Shapes 2022.2.105

# group: Input checked
boolean = BoolSelector(true)
string = StringInput("¿Quieres escribir?")
boolean_input = Custom[Boolean input](InputName=string)  # package Data-Shapes; Creates a boolean input for UI.MultipleInputForm ++ . Check out www.data-shapes.net for more infos!

code_block = CodeBlock { "Descripcion"; "Texto boton"; }

# group: Input color
string_2 = StringInput("Selecciona un color")
colorinput_data = Custom[ColorInput Data](InputName=string_2, ButtonText=string_2)  # package Data-Shapes; Create a color selection input for UI.MultiInputForm++ . Check out www.data-shapes.net for more infos! Warning : Only works with Revit 2017

# group: Input desplegables
string_3 = StringInput("Version de revit")
code_block_2 = CodeBlock { "2019"; "2020"; "2021"; }
list_create = List.Create(item0=code_block_2.out0, item1=code_block_2.out1, item2=code_block_2.out2)
dropdown_data = Custom[DropDown Data](InputName=string_3, Keys=list_create, Values=list_create)  # package Data-Shapes; Create data for DropDown input in UI.MultiInputForm ++ . Check out www.data-shapes.net for more infos.

# group: Selector de archivos
string_4 = StringInput("Selecciona una carpeta")
directorypath_data = Custom[DirectoryPath Data](InputName=string_4, ButtonText=string_4)  # package Data-Shapes; Creates a DirectoryPath input for UI.MultipleInputForm ++ . Check out www.data-shapes.net for more infos!

# group: Input slider
string_5 = StringInput("Selecciona repeticioens")
code_block_3 = CodeBlock { 0; 10; 5; 1; }
slider = Custom[Slider](InputName=string_5, Minimum=code_block_3.out0, Maximum=code_block_3.out1, Default_Value=code_block_3.out2, Step=code_block_3.out3)  # package Data-Shapes; Creates slider input for UI.MultipleInputForm ++ . Set the step to decimal value if you want a double slider, or to a integer value if you want an integer slider.

# group: Input texto
string_6 = StringInput("Introduce un texto")
textbox_data = Custom[TextBox Data](InputName=string_6)  # package Data-Shapes; Create Data for TextBox input in UI.MultipleInputForm ++ . Check out www.data-shapes.net for more informations

list_create_2 = List.Create(item0=boolean_input, item1=colorinput_data, item2=dropdown_data, item3=directorypath_data, item4=slider, item5=textbox_data)
boolean_2 = BoolSelector(true)
multipleinputform = Custom[MultipleInputForm ++](Description_optional=code_block.out0, ButtonText_optional=code_block.out1, Inputs=list_create_2, Toggle=boolean_2)  # package Data-Shapes; Create a form with multiple inputs. see www.data-shapes.net for tutorials and infos!
watch = Watch(multipleinputform.User_Inputs)
