# Dynamo graph listas 1.dyn (Dynamo 2.13.1.3887)

# group: Creacion de listas
number = DoubleInput(2)
number_2 = DoubleInput(5)
boolean = BoolSelector(false)
string = StringInput("\"hola\"")
list_create = List.Create(item0=number, item1=number_2, item2=boolean, item3=string)
watch = Watch(list_create)

# group: Creacion de listas 2
number_3 = DoubleInput(0)
number_4 = DoubleInput(10)
number_slider = DoubleSlider(3, range=0..100 step 0.1)
range = Range(start=number_3, end=number_4, step=number_slider)
watch_2 = Watch(range)

# group: Creacion de listas 3
number_5 = DoubleInput(0)
number_6 = DoubleInput(10)
number_slider_2 = DoubleSlider(3, range=0..100 step 0.1)
sequence = Sequence(start=number_5, amount=number_6, step=number_slider_2)
watch_3 = Watch(sequence)

# group: Operaciones con listas
# note: Numero de elemntos de una lista
count = List.Count(list=watch)
# note: Obtener un elemento de indice de dado
number_7 = DoubleInput(2)
getItemAtIndex = List.GetItemAtIndex(list=watch_2, index=number_7)
# note: Invertir orden de una lista
reverse = List.Reverse(list=watch_2)
list_create_2 = List.Create(item0=watch, item1=watch_2, item2=watch_3)
# note: Concatenar listas
watch_4 = Watch(list_create_2)
flatten = List.Flatten(list=watch_4)
# note: Aplanar una lista
watch_5 = Watch(flatten)
boolean_2 = BoolSelector(false)
boolean_3 = BoolSelector(false)
boolean_4 = BoolSelector(true)
boolean_5 = BoolSelector(false)
# note: Filtrar por mascara de booleanos
list_create_3 = List.Create(item0=boolean_2, item1=boolean_3, item2=boolean_4, item3=boolean_5)
filterByBoolMask = List.FilterByBoolMask(list=watch_3, mask=list_create_3)
watch_6 = Watch(filterByBoolMask.in)
watch_7 = Watch(filterByBoolMask.out)
