# Dynamo graph Generacion de planos.dyn (Dynamo 2.13.1.3887)
# packages: Data-Shapes 2022.2.105

# group: Interfaz grafica para obtener el fichero y el nombre
code_block = CodeBlock { "Generar planos a partir de un archivo excel"; "Generar"; "Cancelar"; 500; }
string = StringInput("Seleccionar fichero")
filepath_data = Custom[FilePath Data](ButtonText=string)  # package Data-Shapes; Create filepath input for UI.MultipleInputForm ++ . Check out www.data-shapes.net for more infos !
string_2 = StringInput("Introduce el nombre de la hoja donde se encuentran los planos")
textbox_data = Custom[TextBox Data](InputName=string_2)  # package Data-Shapes; Create Data for TextBox input in UI.MultipleInputForm ++ . Check out www.data-shapes.net for more informations
list_create = List.Create(item0=filepath_data, item1=textbox_data)
boolean = BoolSelector(true)
multipleinputform = Custom[MultipleInputForm ++](Description_optional=code_block.out0, ButtonText_optional=code_block.out1, Inputs=list_create, Toggle=boolean, CancelButtonText_optional=code_block.out2, Width_optional=code_block.out3)  # package Data-Shapes; Create a form with multiple inputs. see www.data-shapes.net for tutorials and infos!

# group: Seleccionamos el fichero excel con los planos
code_block_2 = CodeBlock { 0; 1; }
getItemAtIndex = List.GetItemAtIndex(list=multipleinputform.User_Inputs, index=code_block_2.out0)
file_from_path = FileObject(path=getItemAtIndex)
getItemAtIndex_2 = List.GetItemAtIndex(list=multipleinputform.User_Inputs, index=code_block_2.out1)
importExcel = Data.ImportExcel(file=file_from_path, sheetName=getItemAtIndex_2)

# group: Creacion del plano
restOfItems = List.RestOfItems(list=importExcel)
transpose = List.Transpose(lists=restOfItems)
code_block_3 = CodeBlock(a=transpose) { a[1]; }
code_block_4 = CodeBlock(a=transpose) { a[0]; }
family_types = FamilyTypes("A1 métrico:A1 métrico")
byNameNumberTitleBlock = Sheet.ByNameNumberTitleBlock(sheetName=code_block_3, sheetNumber=code_block_4, titleBlockFamilyType=family_types)

# group: Asignamos valores de los planos
code_block_5 = CodeBlock(a=importExcel) { a[0]; }
code_block_6 = CodeBlock { [0, 1]; }
removeItemAtIndex = List.RemoveItemAtIndex(list=code_block_5, indices=code_block_6)
removeItemAtIndex_2 = List.RemoveItemAtIndex(list=transpose, indices=code_block_6)
setParameterByName = Element.SetParameterByName(element=byNameNumberTitleBlock, parameterName=removeItemAtIndex@L1, value=removeItemAtIndex_2@L2)
